# Grasshopper definition nummerierung.gh (Grasshopper 1.0.8)
# plug-ins: Human

crv = Curve([<curve referenced from the Rhino model> x10])
rev = ReverseList(List=crv)
crv_2 = Curve([<curve referenced from the Rhino model> x19])
crv_3 = Curve([<curve referenced from the Rhino model> x34])
relay = Relay([crv_2, rev, crv_3])
explode = Explode(Curve=relay, Recursive=True)  # -> Segments, Vertices
area = Area(Geometry=relay)  # -> Area, Centroid
lng = ListLength(List=area.Centroid)
area_2 = Area(Geometry=crv_3)  # -> Area, Centroid
len = Length(Curve=explode.Segments)
lng_2 = ListLength(List=area_2.Centroid)
sort = SortList(Keys=len, ValuesA=explode.Segments)  # -> Keys, ValuesA
py3 = Python3Script(x=lng, y=Slider(1, range=0..1))  # -> out, a, b
# ---------- py3: Python ----------
a = []
for i in range(x):
    s_i = int(y+i)
    if s_i < 10:
        s_i = "P0" + str(s_i)
    else:
        s_i = "P" + str(s_i)
    a.append(s_i)


b = i+2
# ---------- end py3 ----------
item = ListItem(List=sort.ValuesA, Index=0, Wrap=True)  # -> flatten(Item)
py3_2 = Python3Script(x=lng_2, y=py3.b)  # -> out, a, b; same code as py3
end = EndPoints(Curve=item)  # -> Start, End
vec2pt = Vector2Pt(PointA=end.Start, PointB=end.End, Unitize=True)  # -> Vector, Length
pl = ConstructPlane(Origin=area.Centroid, XAxis=vec2pt.Vector, YAxis=Vector(0, 1, 0))
py3_3 = Python3Script(planes=pl)  # -> out, a; inputs planes: list of Plane
# ---------- py3_3: Python ----------
import Rhino.Geometry as rg
a = []

for i,p in enumerate(planes):
    vec = p.ZAxis.IsParallelTo( rg.Vector3d(0,0,1) ) 
    if vec is not 1:
        #p.ZAxis = rg.Vector3d(0,0,1)
        p.Flip()
    planes[i]=p
a = planes
# ---------- end py3_3 ----------
justified_text = JustifiedText3d(
    Location=py3_3.a,
    Text=py3.a,
    Size=Slider(0.8, range=0..1),
    HorizontalAlignment=1,
    VerticalAlginment=1,
    UseMeshes=False,
    Bake=Button())
